% Simulink data dictionary bus_definition.sldd

simulation = struct(
  CoM_alingment=[0 0 0],
  Larm=0.065,
  geometry="skew-redundant",
  imu1_alignment=[0 0 0],
  imu2_alignment=[0 0 0],
  imu3_alignment=[0 0 0],
  imu1_eulerangles=[0 0 0],
  imu2_eulerangles=[0 120 45],
  imu3_eulerangles=[0 120 180],
  imu4_eulerangles=[0 120 -45],
  motion="constantZ",
  omega_V=[0 0 1.256637
   0 0 1.256637
   0 0 1.256637
   0 0 1.256637
   0 0 1.256637
   0 0 1.256637
   0 0 1.256637
   0 0 1.256637
   0 0 1.256637
   0 0 1.256637
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   ])

EKFBias = Simulink.Bus()
  bias_B1: double[3], Unit="rad/s"
  bias_B2: double[3], Unit="rad/s"
  bias_B3: double[3], Unit="rad/s"
  bias_B4: double[3], Unit="rad/s"

EKFOmegaV_corrected = Simulink.Bus()
  omega_V1_corrected: double[3], Unit="rad/s"
  omega_V2_corrected: double[3], Unit="rad/s"
  omega_V3_corrected: double[3], Unit="rad/s"
  omega_V4_corrected: double[3], Unit="rad/s"

EKF_quat = Simulink.Bus()
  quat1: double[4]
  quat2: double[4]
  quat3: double[4]
  quat4: double[4]

EKF_quatprop = Simulink.Bus()
  quat1: double[4]
  quat2: double[4]
  quat3: double[4]
  quat4: double[4]

EKF_quatbefore = Simulink.Bus()
  quat1: double[4]
  quat2: double[4]
  quat3: double[4]
  quat4: double[4]

SIMkinematics = Simulink.Bus()
  omega_V: double[3]
  acc_V: double[3]
  mag_V: double[3]
  quat_NV: double[4]
  DCM_VN: double[3 3]
  euler: double[3]

SensorData = Simulink.Bus()
  omega_B1_meas: double[3], Unit="deg/s"  % Angular rates of the IMU 1 in sensor body coordinates [deg/s]
  omega_B2_meas: double[3], Unit="deg/s"  % Angular rates of the IMU 2 in sensor body coordinates [deg/s]
  omega_B3_meas: double[3], Unit="deg/s"  % Angular rates of the IMU 3 in sensor body coordinates [deg/s]
  omega_B4_meas: double[3], Unit="deg/s"  % Angular rates of the IMU 3 in sensor body coordinates [deg/s]
  acc_B1_meas: double[3], Unit="m/s2"  % Acceleration of the IMU 1 in sensor body coordinates [m/s2]
  acc_B2_meas: double[3], Unit="m/s2"  % Acceleration of the IMU 2 in sensor body coordinates [m/s2]
  acc_B3_meas: double[3], Unit="m/s2"  % Acceleration of the IMU 3 in sensor body coordinates [m/s2]
  acc_B4_meas: double[3], Unit="m/s2"  % Acceleration of the IMU 4 in sensor body coordinates [m/s2]
  mag_B1_meas: double[3], Unit="µT"  % Magnetic field of the IMU 1 in sensor body coordinates
  mag_B2_meas: double[3], Unit="μT"
  mag_B3_meas: double[3], Unit="μT"
  mag_B4_meas: double[3], Unit="μT"

SensorDynamics = Simulink.Bus()
  omega_B1: double[3]
  omega_B2: double[3]
  omega_B3: double[3]
  omega_B4: double[3]
  acc_B1: double[3]
  acc_B2: double[3]
  acc_B3: double[3]
  acc_B4: double[3]
  mag_B1: double[3]
  mag_B2: double[3]
  mag_B3: double[3]
  mag_B4: double[3]

CONFIG = Simulink.Bus()
  omega_V: double[3], Unit="deg/s"  % Angular rates of the CoM in CoM body coordinates [deg/s]
  CoM_alignment: double[3], Unit="deg"  % Initial attitude of the body wrt the inertial reference frame [deg]
  Larm: double, Unit="m"  % Lever arm from the sensors to the CoM [m]
  geometry: string  % It can be either in-plane or skew-redundant
  quat1_VB: double[4]
  quat2_VB: double[4]
  quat3_VB: double[4]
  quat4_VB: double[4]

SIMin = Simulink.Bus()
  omega_V: double[3]
  euler: double[3]